# Grasshopper definition filter data test.gh (Grasshopper 1.0.7)
# plug-ins: Pufferfish, Runway

# ---- group: Input data from Runway
# Test of "Filter Data"s output runway model
# This example was tested on PoseNet model in runway.
# 
# First, after opening rhino model (name: filter data) and putting values for "Input http" and make sure that runway is running.
# Then, please turn toggle 1  to True and enable "Custom Preview" components.
# The input point's role is to determine the approximate distance. (Please input numerical min and max to "construct domain" component in the "Finding out numerical tolerence" group)
panel = Panel("http://localhost:8000")
# 1
boolean_toggle = BooleanToggle(True)
runway = Runway(InputHttp=panel, Data=boolean_toggle, Info=False, Error=False, Run=boolean_toggle)  # -> OutputRunwayData, OutputRunwayInfo, OutputRunwayError
filterdata = FilterData(InputData=runway.OutputRunwayData)  # -> NumberInModel, NameCategory, OutputData

# ----
point = Point(<point referenced from the Rhino model>)

# ---- group: Finding hands skeleton's points
last_index = LastIndex(List=filterdata.NumberInModel)
cull_index = CullIndex(List=filterdata.NumberInModel, Indices=last_index, Wrap=True)
partition_list = PartitionList(List=cull_index, Size=Slider(2, range=0..10))
list_item = ListItem(List=partition_list, Index=0, Wrap=True)  # -> Item, Item1
construct_point = ConstructPoint(XCoordinate=expr("-x+10", list_item.Item), YCoordinate=expr("-x+10", list_item.Item1), ZCoordinate=0)
list_item_2 = ListItem(List=flatten(construct_point), Index=Slider(9, range=0..18), Wrap=True)
list_item_3 = ListItem(List=flatten(construct_point), Index=Slider(10, range=0..18), Wrap=True)

# ---- group: Finding out numerical tolerence
multiplication = Multiplication(A=list_item_3, B=Slider(10, range=0..10))
multiplication_2 = Multiplication(A=list_item_2, B=Slider(10, range=0..10))
deconstruct = Deconstruct(Point=multiplication_2)  # -> XComponent, YComponent, ZComponent
deconstruct_2 = Deconstruct(Point=multiplication)  # -> XComponent, YComponent, ZComponent
deconstruct_3 = Deconstruct(Point=point)  # -> XComponent, YComponent, ZComponent
# Please check the output of the subtraction component.
addition = Addition(A=deconstruct.YComponent, B=deconstruct_2.YComponent)
subtraction = Subtraction(A=addition, B=deconstruct_3.YComponent)
construct_domain = ConstructDomain(DomainStart=Slider(176, range=0..1000), DomainEnd=Slider(190, range=0..1000))
remap_numbers = RemapNumbers(Value=subtraction, Source=construct_domain, Target="4")  # -> Mapped, Clipped

# ---- group: Showing data
cluster = Cluster(integer=remap_numbers.Mapped)  # -> i, item_1, item_2, item_3, item_4
brep = Brep([<brep referenced from the Rhino model> x192])
brep_2 = Brep([<brep referenced from the Rhino model> x768])
brep_3 = Brep([<brep referenced from the Rhino model> x336])
brep_4 = Brep([<brep referenced from the Rhino model> x480])
brep_5 = Brep([<brep referenced from the Rhino model> x300])
custom_preview = CustomPreview(Geometry=brep, Material=cluster.i)  # disabled
custom_preview_2 = CustomPreview(Geometry=brep_2, Material=cluster.item_1)  # disabled
custom_preview_3 = CustomPreview(Geometry=brep_3, Material=cluster.item_2)  # disabled
custom_preview_4 = CustomPreview(Geometry=brep_4, Material=cluster.item_3)  # disabled
custom_preview_5 = CustomPreview(Geometry=brep_5, Material=cluster.item_4)  # disabled

# ==== cluster Cluster

colour_rgb = ColourRGB(Alpha=255, Red=Slider(65, range=0..255), Green=Slider(65, range=0..255), Blue=Slider(91, range=0..255))

colour_rgb_2 = ColourRGB(Alpha=255, Red=Slider(203, range=0..255), Green=Slider(134, range=0..255), Blue=Slider(23, range=0..255))

colour_rgb_3 = ColourRGB(Alpha=255, Red=Slider(49, range=0..255), Green=Slider(142, range=0..255), Blue=Slider(23, range=0..255))

colour_rgb_4 = ColourRGB(Alpha=255, Red=Slider(197, range=0..255), Green=Slider(172, range=0..255), Blue=Slider(57, range=0..255))

colour_rgb_5 = ColourRGB(Alpha=255, Red=Slider(44, range=0..255), Green=Slider(197, range=0..255), Blue=Slider(190, range=0..255))

colour_rgb_6 = ColourRGB(Alpha=255, Red=Slider(65, range=0..255), Green=Slider(65, range=0..255), Blue=Slider(91, range=0..255))

colour_rgb_7 = ColourRGB(Alpha=255, Red=Slider(203, range=0..255), Green=Slider(134, range=0..255), Blue=Slider(23, range=0..255))

colour_rgb_8 = ColourRGB(Alpha=255, Red=Slider(49, range=0..255), Green=Slider(142, range=0..255), Blue=Slider(23, range=0..255))

colour_rgb_9 = ColourRGB(Alpha=255, Red=Slider(197, range=0..255), Green=Slider(172, range=0..255), Blue=Slider(57, range=0..255))

colour_rgb_10 = ColourRGB(Alpha=255, Red=Slider(44, range=0..255), Green=Slider(197, range=0..255), Blue=Slider(190, range=0..255))

colour_rgb_11 = ColourRGB(Alpha=255, Red=Slider(65, range=0..255), Green=Slider(65, range=0..255), Blue=Slider(91, range=0..255))

colour_rgb_12 = ColourRGB(Alpha=255, Red=Slider(203, range=0..255), Green=Slider(134, range=0..255), Blue=Slider(23, range=0..255))

colour_rgb_13 = ColourRGB(Alpha=255, Red=Slider(49, range=0..255), Green=Slider(142, range=0..255), Blue=Slider(23, range=0..255))

colour_rgb_14 = ColourRGB(Alpha=255, Red=Slider(197, range=0..255), Green=Slider(172, range=0..255), Blue=Slider(57, range=0..255))

colour_rgb_15 = ColourRGB(Alpha=255, Red=Slider(44, range=0..255), Green=Slider(197, range=0..255), Blue=Slider(190, range=0..255))

merge = Merge(Data1=colour_rgb_3, Data2=colour_rgb, Data3=colour_rgb_4, Data4=colour_rgb_2, Data5=colour_rgb_5)

merge_2 = Merge(Data1=colour_rgb_10, Data2=colour_rgb_9, Data3=colour_rgb_8, Data4=colour_rgb_7, Data5=colour_rgb_6)

merge_3 = Merge(Data1=colour_rgb_11, Data2=colour_rgb_12, Data3=colour_rgb_13, Data4=colour_rgb_14, Data5=colour_rgb_15)

colour_rgb_16 = ColourRGB(Alpha=255, Red=Slider(65, range=0..255), Green=Slider(65, range=0..255), Blue=Slider(91, range=0..255))

colour_rgb_17 = ColourRGB(Alpha=255, Red=Slider(203, range=0..255), Green=Slider(134, range=0..255), Blue=Slider(23, range=0..255))

colour_rgb_18 = ColourRGB(Alpha=255, Red=Slider(49, range=0..255), Green=Slider(142, range=0..255), Blue=Slider(23, range=0..255))

colour_rgb_19 = ColourRGB(Alpha=255, Red=Slider(197, range=0..255), Green=Slider(172, range=0..255), Blue=Slider(57, range=0..255))

colour_rgb_20 = ColourRGB(Alpha=255, Red=Slider(44, range=0..255), Green=Slider(197, range=0..255), Blue=Slider(190, range=0..255))

colour_rgb_21 = ColourRGB(Alpha=255, Red=Slider(65, range=0..255), Green=Slider(65, range=0..255), Blue=Slider(91, range=0..255))

colour_rgb_22 = ColourRGB(Alpha=255, Red=Slider(203, range=0..255), Green=Slider(134, range=0..255), Blue=Slider(23, range=0..255))

colour_rgb_23 = ColourRGB(Alpha=255, Red=Slider(49, range=0..255), Green=Slider(142, range=0..255), Blue=Slider(23, range=0..255))

colour_rgb_24 = ColourRGB(Alpha=255, Red=Slider(197, range=0..255), Green=Slider(172, range=0..255), Blue=Slider(57, range=0..255))

colour_rgb_25 = ColourRGB(Alpha=255, Red=Slider(44, range=0..255), Green=Slider(197, range=0..255), Blue=Slider(190, range=0..255))

integer = ClusterInput()
integer_2 = Integer(integer)

merge_4 = Merge(Data1=colour_rgb_19, Data2=colour_rgb_16, Data3=colour_rgb_18, Data4=colour_rgb_20, Data5=colour_rgb_17)

merge_5 = Merge(Data1=colour_rgb_22, Data2=colour_rgb_21, Data3=colour_rgb_23, Data4=colour_rgb_25, Data5=colour_rgb_24)

stream_filter = StreamFilter(Gate=integer_2, Stream0=merge_3, Stream1=merge_2, Stream2=merge, Stream3=merge_4, Stream4=merge_5)
list_item = ListItem(List=stream_filter, Index=0, Wrap=True)  # -> Item, Item1, Item2, Item3, Item4
i = ClusterOutput(list_item.Item)
item_1 = ClusterOutput(list_item.Item1)
item_2 = ClusterOutput(list_item.Item2)
item_3 = ClusterOutput(list_item.Item3)
item_4 = ClusterOutput(list_item.Item4)
