# Grasshopper definition image show test.gh (Grasshopper 1.0.7)
# plug-ins: Firefly.X, Runway

# ---- group: Obtaining data from Runway
# Test of "Show Image"s output runway model
# This example was tested on CycleGAN model in runway.
# 
# First, after putting values for "Input http" and make sure that runway is running and you have FireFly already installed.
# Then, please turn toggle 1 & 2 to True.
# (Due to high processing power needed for this component, in runway's "image option" please set width and height to low values)
panel = Panel("http://localhost:8000")
# 1
boolean_toggle = BooleanToggle(True)
runway = Runway(InputHttp=panel, Data=boolean_toggle, Info=False, Error=False, Run=boolean_toggle)  # -> OutputRunwayData, OutputRunwayInfo, OutputRunwayError
# 2
boolean_toggle_2 = BooleanToggle(False)
show_image = ShowImage(InputRunwayData=runway.OutputRunwayData, Run=boolean_toggle_2)  # -> Red, Green, Blue, Alfa, Width, Height

# ---- group: Showing image data received from Runway
partition_list = PartitionList(List=reverse(show_image.Red), Size=show_image.Width)
partition_list_2 = PartitionList(List=reverse(show_image.Green), Size=show_image.Width)
partition_list_3 = PartitionList(List=reverse(show_image.Blue), Size=show_image.Width)
flip_matrix = FlipMatrix(Data=partition_list)  # -> reverse(flatten(Data))
flip_matrix_2 = FlipMatrix(Data=partition_list_2)  # -> reverse(flatten(Data))
flip_matrix_3 = FlipMatrix(Data=partition_list_3)  # -> reverse(flatten(Data))
bitmap_recompose = BitmapRecompose(
    RedChannel=flip_matrix,
    GreenChannel=flip_matrix_2,
    BlueChannel=flip_matrix_3,
    AlphaChannel=show_image.Alfa,
    XResolution=show_image.Width,
    YResolution=show_image.Height)
bitmap_painter = BitmapPainter(BitmapToPaint=bitmap_recompose)
